# Grasshopper definition 150401_ComplexMeshWithVariousConstraints.gh (Grasshopper 0.9.76)
# plug-ins: MeshEdit Components, Python Interpreter

# ---- group: Generate a complex mesh (open to change parameters)
gcm = GenerateComplexMesh()

# ----
mesh = Mesh(gcm)

# ---- group: Get Mesh Vertex Positions
demesh = DeconstructMesh(Mesh=mesh)  # -> Vertices, Faces, Colours, Normals

# ---- group: Make Anchor Constraints
cluster = Cluster(pt=demesh.Vertices)
anchorgeo = Geometry(cluster)
mesh_2 = Mesh(mesh)
soai = ShapeOpAnchorsIndexer(Mesh=mesh_2, AnchorGeo=anchorgeo)  # -> PointIndices, AnchorPts; inputs Mesh: Mesh, AnchorGeo: list
# ---------- soai: Python ----------
"""
Gets the vertex indices of the mesh which corresponds to the points of the AnchorGeo.
If the AnchorGeo is a curve/polyline/line its start-point will be used to identify 
which mesh vertex should be anchored and its end-point will be used to determine
which point to anchor the vertex to. If the AnchorGeo is point this will be used
as both identifier and anchor point. Use curve-types to interactively manipulate
anchoring positions and points for static positions.
-
Authors: Anders Holden Deleuran (CITA/KADK), Mario Deuss (LGG/EPFL) 
Github: github.com/AndersDeleuran/ShapeOpGHPython
Updated: 150401
    Args:
        Mesh: The mesh to extract vertex indices from.
        AnchorGeo: Geometry to use for anchoring mesh vertices (points or curve-type).
    Returns:
        PointIndices: The mesh with vertices to anchor.
        AnchorPts: The anchor points.
"""

import Rhino as rc
import Grasshopper as gh

# Set component name
ghenv.Component.Name = "ShapeOpAnchorsIndexer"
ghenv.Component.NickName = "SOAI"

if AnchorGeo and Mesh and not None in AnchorGeo:
    
    # Make output datatrees
    PointIndices = gh.DataTree[int]()
    AnchorPts = gh.DataTree[rc.Geometry.Point3d]()
    
    # Make mesh vertices point search list
    ptsList = rc.Collections.Point3dList(Mesh.Vertices.ToPoint3dArray())
    
    for i,ag in enumerate(AnchorGeo):
        
        # Make datatree path
        p = gh.Kernel.Data.GH_Path(i)
        
        # Get anchor start and end points
        if isinstance(ag,rc.Geometry.Curve):
            aPtS = ag.PointAtStart
            aPtE = ag.PointAtEnd
        elif isinstance(ag,rc.Geometry.Point3d):
            aPtS = ag
            aPtE = ag
            
        # Get index of points to anchor and add to PointIndices datatree
        aPtId = ptsList.ClosestIndex(aPtS)
        PointIndices.AddRange((aPtId,),p)
        
        # Add anchor end points to datatree
        AnchorPts.Add(aPtE,p)
        
else:
    PointIndices = []
    AnchorPts = []
# ---------- end soai ----------
list = ValueList({"EdgeStrain", "TriangleStrain", "TetrahedronStrain", "Area", "Volume", "Bending", "Closeness", "Line", "Plane", "Circle", "Sphere", "Similarity", "Rigid", "Rectangle", "Parallelogram", "Laplacian", "LaplacianDisplacement", "Angle"}, selected="Closeness")
socsig = ShapeOpConstraintSignature(ConstraintType=list, PointIndices=soai.PointIndices, Weights=Slider(20000, range=0..20000), Scalars=soai.AnchorPts)  # -> ConstraintSigs; inputs PointIndices: tree of Int32, Weights: list, Scalars: tree
# ---------- socsig: Python ----------
"""
Construct the signatures which are used by the ShapeOpConstraintSolver
component to add and edit ShapeOp constraints.
-
Authors: Anders Holden Deleuran (CITA/KADK), Mario Deuss (LGG/EPFL) 
Github: github.com/AndersDeleuran/ShapeOpGHPython
Updated: 150330
    Args:
        ConstraintType:
            A string containing one of the following constraint types (see documentation for more info):
                -
                EdgeStrain = takes 2 indices forming an edge.
                TriangleStrain = takes 3 indices forming a triangle.
                TetrahedronStrain = takes 4 indices forming a tetrahedron.
                Area = takes 3 indices forming a triangle.
                Volume = takes 4 indices forming a tetrahedron.
                Bending = takes 4 indices of two neighboring triangles sharing an edge.
                Closeness = takes 1 index.
                Line = takes 2 or more indices.
                Plane = takes 3 or more indices.
                Circle = takes 3 or more indices.
                Sphere = takes 4 or more indices.
                Similarity = takes 1 or more indices.
                Rigid = takes 1 or more indices.
                Rectangle = takes 4 indices.
                Parallelogram = takes 4 indices.
                Laplacian = takes 2 or more indices, center vertex first, then the one ring neighborhood.
                LaplacianDisplacement = takes 2 or more indices, center vertex first, then the one ring neighborhood.
                AngleConstraint = takes 3 indices forming two consecutive edges.
        PointIndices:
            A datatree of indices of the points subject to the constraints.
        Weights:
            A list of weights of the constraints to be added relative to the other constraints in the ShapeOpSolver (if a single value is provided the same weight will be used).
        Scalars:
            A datatree of floats used to edit certain constraints after they have been created, rangeMin/rangeMax are multipliers (if a single list is provided the same scalars will be used).
                -
                EdgeStrain = The scalars have 3 entries: (1) the desired distance between the two constrained vertices; (2) rangeMin; (3) rangeMax.
                TriangleStrain = The scalars have 2 entries: (1) rangeMin; (2) rangeMax.
                TetrahedronStrain = The scalars have 2 entries: (1) rangeMin; (2) rangeMax.
                Area = The scalars have 2 entries: (1) rangeMin; (2) rangeMax.
                Volume = The scalars have 2 entries: (1) rangeMin; (2) rangeMax.
                Bending = The scalars have 2 entries: (1) rangeMin; (2) rangeMax.
                Closeness = The scalars have 3 entries, which are the desire coordinates of constrained vertex.
                Similarity = The scalars have 3 * n * m entries, where m is the number of candidate shapes that the constrained vertices should be similar to,and n is the number of points in each candidate shape (the same as the number of constrained vertices). Each block of 3 * n scalars provides the point coordinates of a candidate shape.
                Rigid = Same as for "Similarity", see above.
                AngleConstraint =The scalars have 2 entries: (1) minAngle; (2) maxAngle.
    Returns:
        ConstraintSigs: A Python dictionary which wraps all the data for constructing the constraints.
"""

import Rhino as rc

# Set component name
ghenv.Component.Name = "ShapeOpConstraintSignature"
ghenv.Component.NickName = "SOCSig"

if PointIndices.DataCount and ConstraintType and len(Weights):    
    
    # Make dict for storing shapeop constraint signature
    ConstraintSigs = {"type":ConstraintType, "pointIndices":[], "weights":[], "scalars":[]}
    
    # Convert PointIndices datatree to nested Python list and add to dict
    ConstraintSigs["pointIndices"] = [list(i) for i in PointIndices.Branches]
    
    # Add Scalars to dict if there are any
    if Scalars.DataCount:
        
        # Convert datatree to python list and ensure that length matches PointIndices
        scalars = [list(i) for i in Scalars.Branches]
        if len(scalars) != PointIndices.BranchCount:
            scalars = [list(Scalars.Branches[0]) for i in range(PointIndices.BranchCount)]
            
        # Case for point scalars datatree
        if isinstance(scalars[0][0],rc.Geometry.Point3d):
            for l in scalars:
                coords = []
                for pt in l:
                    coords.append(pt.X)
                    coords.append(pt.Y)
                    coords.append(pt.Z)
                ConstraintSigs["scalars"].append(coords)
                
        # Case for simple float datatree
        else:
            ConstraintSigs["scalars"] = scalars
            
    # Add weights to dict
    if len(Weights) != PointIndices.BranchCount:
        ConstraintSigs["weights"] = [Weights[0] for i in range(PointIndices.BranchCount)]
    else:
        ConstraintSigs["weights"] = Weights

    # Output to GH (wrap in list to send as one item)
    ConstraintSigs = [ConstraintSigs,]
    
else:
    ConstraintSigs = []
# ---------- end socsig ----------

# ----
list_2 = ValueList({"FaceVertices": "faceVertices", "VertexNeighbours": "vertexNeighbours", "EdgeVertices": "edgeVertices", "VerticesAll": "verticesAll", "VerticesEach": "verticesEach", "EdgeFaceVertices": "edgeFaceVertices", "FaceAngleVertices": "faceAngleVertices", "NakedVertices": "nakedVertices"}, selected="FaceVertices")
tri = Triangulate(Mesh=mesh)  # -> Mesh, Count
list_3 = ValueList({"EdgeStrain", "TriangleStrain", "TetrahedronStrain", "Area", "Volume", "Bending", "Closeness", "Line", "Plane", "Circle", "Sphere", "Similarity", "Rigid", "Rectangle", "Parallelogram", "Laplacian", "LaplacianDisplacement", "Angle"}, selected="TriangleStrain")
somi = ShapeOpMeshIndexer(Pattern=list_2, Mesh=tri.Mesh)  # -> PointIndices; inputs Mesh: Mesh
# ---------- somi: Python ----------
"""
Extract vertex indices from a mesh using various patterns.
-
Authors: Anders Holden Deleuran (CITA/KADK), Mario Deuss (LGG/EPFL) 
Github: github.com/AndersDeleuran/ShapeOpGHPython
Updated: 150401
    Args:
        Pattern:
            The vertex indices pattern to extract from the mesh:
                -
                faceVertices = vertex indices for each face.
                vertexNeighbours = neighbour vertex indices for each vertex.
                edgeVertices = vertex indices for each edge.
                verticesAll = vertex indices for each vertex (flat list).
                verticesEach = vertex indices for each vertex (datatree).
                edgeFaceVertices = neighbour face-vertex indices for each edge (use for bending).
                faceAngleVertices = neighbour vertices for each vertex corner for each face.
                nakedVertices = vertices on the perimeter of the mesh, sorted by closed loops.
        Mesh: The mesh to extract vertex indices from.
    Returns:
        PointIndices: The vertex indices pattern.
"""

import Grasshopper as gh

# Set component name
ghenv.Component.Name = "ShapeOpMeshIndexer"
ghenv.Component.NickName = "SOMI"

def getFaceVertices(mesh):
    
    """ Get datatree with the face vertex indices for each face in a mesh """
    
    faceVertices = gh.DataTree[int]()
    
    for i in range(Mesh.Faces.Count):
        fl = Mesh.Faces.Item[i]
        if fl.IsQuad:
            fIDs = (fl.A,fl.B,fl.C,fl.D)
        else:
            fIDs = (fl.A,fl.B,fl.C)
        faceVertices.AddRange(fIDs,gh.Kernel.Data.GH_Path(i))
        
    return faceVertices

def getVertexNeighbours(mesh):
    
    """ Get datatree with the vertex plus vertex neighbour indices
    for each vertex in a mesh """
    
    vertexNeighbours = gh.DataTree[int]()
    
    for i in range(Mesh.Vertices.Count):
        vnIDs = [i] + list(Mesh.Vertices.GetConnectedVertices(i))
        vertexNeighbours.AddRange(vnIDs,gh.Kernel.Data.GH_Path(i))
        
    return vertexNeighbours

def getEdgeVertices(mesh):
    
    """ Get datatree with the edge vertex indices for each edge in mesh """
    
    # Get edge vertices
    edges = []
    for i in range(Mesh.Vertices.Count):
        neighbours = Mesh.Vertices.GetConnectedVertices(i)
        for n in neighbours:
            if n > i:
                edges.append((i,n))
                
    # Make datatree
    edgeVertices = gh.DataTree[int]()
    for i,e in enumerate(edges):
        edgeVertices.AddRange(e,gh.Kernel.Data.GH_Path(i))
        
    return edgeVertices

def getVerticesEach(mesh):
    
    """ Get datatree with the index of each vertex in a mesh """
    
    verticesEach = gh.DataTree[int]()
    for i in range(Mesh.Vertices.Count):
        verticesEach.AddRange([i],gh.Kernel.Data.GH_Path(i))
        
    return verticesEach

def getVerticesAll(mesh):
    
    """ Get a list with all the vertex indices of a mesh """
    
    verticesAll = range(mesh.Vertices.Count)
    
    return verticesAll

def getEdgeFaceVertices(mesh):
    
    """ Get datatree with the four/six face vertex indices for each mesh edge, 
    which is used to construct the shapeop bending constraint signature """
    
    # Make GH datatree
    edgeFaceVerticesPtIDs = gh.DataTree[int]()
    
    for i in range(mesh.TopologyEdges.Count):
        
        p = gh.Kernel.Data.GH_Path(i)
        
        if len(mesh.TopologyEdges.GetConnectedFaces(i)) == 2:
            
            # Get edge vertex indices
            tVts = mesh.TopologyEdges.GetTopologyVertices(i)
            eVtA = mesh.TopologyVertices.MeshVertexIndices(tVts.I)[0]
            eVtB = mesh.TopologyVertices.MeshVertexIndices(tVts.J)[0]
            eVts = set((eVtA,eVtB))
            
            # Get edge face vertex index
            fA,fB = mesh.TopologyEdges.GetConnectedFaces(i)
            fVtsA = mesh.Faces.GetTopologicalVertices(fA)
            fVtsB = mesh.Faces.GetTopologicalVertices(fB)
            fVtsA = [mesh.TopologyVertices.MeshVertexIndices(i)[0] for i in fVtsA]
            fVtsB = [mesh.TopologyVertices.MeshVertexIndices(i)[0] for i in fVtsB]
            fVts = set(fVtsA + fVtsB)
            
            # Get the face indices which are not part of the edge
            fVts = list(fVts - eVts)
            
            # Make the bending constraint point indices list
            eFVIDs = list(eVts) + fVts
            edgeFaceVerticesPtIDs.AddRange(eFVIDs,p)
            
            
    return edgeFaceVerticesPtIDs

def getFaceAngleVertices(mesh):
    
    """ Get datatree with the face angle vertex indices for each face in a mesh """
    
    faceVertices = gh.DataTree[int]()
    
    n = 0
    for i in range(Mesh.Faces.Count):
        fl = Mesh.Faces.Item[i]
        if fl.IsQuad:
            faceVertices.AddRange((fl.A,fl.B,fl.D),gh.Kernel.Data.GH_Path(n+0))
            faceVertices.AddRange((fl.B,fl.C,fl.A),gh.Kernel.Data.GH_Path(n+1))
            faceVertices.AddRange((fl.C,fl.D,fl.B),gh.Kernel.Data.GH_Path(n+2))
            faceVertices.AddRange((fl.D,fl.A,fl.C),gh.Kernel.Data.GH_Path(n+3))
            n += 4
        else:
            faceVertices.AddRange((fl.A,fl.B,fl.C),gh.Kernel.Data.GH_Path(n+0))
            faceVertices.AddRange((fl.B,fl.C,fl.A),gh.Kernel.Data.GH_Path(n+1))
            faceVertices.AddRange((fl.C,fl.A,fl.B),gh.Kernel.Data.GH_Path(n+2))
            n += 3
            
    return faceVertices

def getNakedVertices(mesh):
    
    """ Get datatree with indices of naked vertices, sorted by closed loops """
    
    # Get naked edges as polylines and naked edge status
    npl = list(mesh.GetNakedEdges())
    nvts = mesh.GetNakedEdgePointStatus()
    
    # Sort the naked vertices by which polyline they belong to
    nakedVertices = gh.DataTree[int]()
    for i,v in enumerate(nvts):
        if v:
            for j,pl in enumerate(npl):
                p = gh.Kernel.Data.GH_Path(j)
                if pl.Contains(mesh.Vertices.Item[i]):
                    nakedVertices.Add(i,p)
                    
    return nakedVertices

if Mesh and Pattern:
    
    if Pattern == "faceVertices":
        PointIndices = getFaceVertices(Mesh)
        
    elif Pattern == "edgeVertices":
        PointIndices = getEdgeVertices(Mesh)
        
    elif Pattern == "vertexNeighbours":
        PointIndices = getVertexNeighbours(Mesh)
        
    elif Pattern == "verticesEach":
        PointIndices = getVerticesEach(Mesh)
        
    elif Pattern == "verticesAll":
        PointIndices = getVerticesAll(Mesh)
        
    elif Pattern == "edgeFaceVertices":
        PointIndices = getEdgeFaceVertices(Mesh)
        
    elif Pattern == "faceAngleVertices":
        PointIndices = getFaceAngleVertices(Mesh)
        
    elif Pattern == "nakedVertices":
        PointIndices = getNakedVertices(Mesh)
else:
    PointIndices = []
# ---------- end somi ----------
merge = Merge(Data1=Slider(1, range=0..2), Data2=Slider(1, range=0..2))
socsig_2 = ShapeOpConstraintSignature(ConstraintType=list_3, PointIndices=somi, Weights=Slider(200, range=0..200), Scalars=merge)  # -> ConstraintSigs; inputs PointIndices: tree of Int32, Weights: list, Scalars: tree
# ---------- socsig_2: Python ----------
"""
Construct signatures which are used by the ShapeOpConstraintSolver
component to add and edit ShapeOp constraints.
-
Authors: Anders Holden Deleuran (CITA/KADK), Mario Deuss (LGG/EPFL) 
Github: github.com/AndersDeleuran/ShapeOpGHPython
Updated: 150330
    Args:
        ConstraintType:
            A string containing one of the following constraint types (see documentation for more info):
                -
                EdgeStrain = takes 2 indices forming an edge.
                TriangleStrain = takes 3 indices forming a triangle.
                TetrahedronStrain = takes 4 indices forming a tetrahedron.
                Area = takes 3 indices forming a triangle.
                Volume = takes 4 indices forming a tetrahedron.
                Bending = takes 4 indices of two neighboring triangles sharing an edge.
                Closeness = takes 1 index.
                Line = takes 2 or more indices.
                Plane = takes 3 or more indices.
                Circle = takes 3 or more indices.
                Sphere = takes 4 or more indices.
                Similarity = takes 1 or more indices.
                Rigid = takes 1 or more indices.
                Rectangle = takes 4 indices.
                Parallelogram = takes 4 indices.
                Laplacian = takes 2 or more indices, center vertex first, then the one ring neighborhood.
                LaplacianDisplacement = takes 2 or more indices, center vertex first, then the one ring neighborhood.
                AngleConstraint = takes 3 indices forming two consecutive edges.
        PointIndices:
            A datatree of indices of the points subject to the constraints.
        Weights:
            A list of weights of the constraints to be added relative to the other constraints in the ShapeOpSolver (if a single value is provided the same weight will be used).
        Scalars:
            A datatree of floats used to edit certain constraints after they have been created, rangeMin/rangeMax are multipliers (if a single list is provided the same scalars will be used).
                -
                EdgeStrain = The scalars have 3 entries: (1) the desired distance between the two constrained vertices; (2) rangeMin; (3) rangeMax.
                TriangleStrain = The scalars have 2 entries: (1) rangeMin; (2) rangeMax.
                TetrahedronStrain = The scalars have 2 entries: (1) rangeMin; (2) rangeMax.
                Area = The scalars have 2 entries: (1) rangeMin; (2) rangeMax.
                Volume = The scalars have 2 entries: (1) rangeMin; (2) rangeMax.
                Bending = The scalars have 2 entries: (1) rangeMin; (2) rangeMax.
                Closeness = The scalars have 3 entries, which are the desire coordinates of constrained vertex.
                Similarity = The scalars have 3 * n * m entries, where m is the number of candidate shapes that the constrained vertices should be similar to,and n is the number of points in each candidate shape (the same as the number of constrained vertices). Each block of 3 * n scalars provides the point coordinates of a candidate shape.
                Rigid = Same as for "Similarity", see above.
                AngleConstraint =The scalars have 2 entries: (1) minAngle; (2) maxAngle.
    Returns:
        ConstraintSigs: A Python dictionary which wraps all the data for constructing the constraints.
"""

import Rhino as rc

# Set component name
ghenv.Component.Name = "ShapeOpConstraintSignature"
ghenv.Component.NickName = "SOCSig"

if PointIndices.DataCount and ConstraintType and len(Weights):    
    
    # Make dict for storing shapeop constraint signature
    ConstraintSigs = {"type":ConstraintType, "pointIndices":[], "weights":[], "scalars":[]}
    
    # Convert PointIndices datatree to nested Python list and add to dict
    ConstraintSigs["pointIndices"] = [list(i) for i in PointIndices.Branches]
    
    # Add Scalars to dict if there are any
    if Scalars.DataCount:
        
        # Convert datatree to python list and ensure that length matches PointIndices
        scalars = [list(i) for i in Scalars.Branches]
        if len(scalars) != PointIndices.BranchCount:
            scalars = [list(Scalars.Branches[0]) for i in range(PointIndices.BranchCount)]
            
        # Case for point scalars datatree
        if isinstance(scalars[0][0],rc.Geometry.Point3d):
            for l in scalars:
                coords = []
                for pt in l:
                    coords.append(pt.X)
                    coords.append(pt.Y)
                    coords.append(pt.Z)
                ConstraintSigs["scalars"].append(coords)
                
        # Case for simple float datatree
        else:
            ConstraintSigs["scalars"] = scalars
            
    # Add weights to dict
    if len(Weights) != PointIndices.BranchCount:
        ConstraintSigs["weights"] = [Weights[0] for i in range(PointIndices.BranchCount)]
    else:
        ConstraintSigs["weights"] = Weights

    # Output to GH (wrap in list to send as one item)
    ConstraintSigs = [ConstraintSigs,]
    
else:
    ConstraintSigs = []
# ---------- end socsig_2 ----------

list_4 = ValueList({"FaceVertices": "faceVertices", "VertexNeighbours": "vertexNeighbours", "EdgeVertices": "edgeVertices", "VerticesAll": "verticesAll", "VerticesEach": "verticesEach", "EdgeFaceVertices": "edgeFaceVertices", "FaceAngleVertices": "faceAngleVertices", "NakedVertices": "nakedVertices"}, selected="FaceVertices")
list_5 = ValueList({"EdgeStrain", "TriangleStrain", "TetrahedronStrain", "Area", "Volume", "Bending", "Closeness", "Line", "Plane", "Circle", "Sphere", "Similarity", "Rigid", "Rectangle", "Parallelogram", "Laplacian", "LaplacianDisplacement", "Angle"}, selected="Circle")
somi_2 = ShapeOpMeshIndexer(Pattern=list_4, Mesh=mesh)  # -> PointIndices; inputs Mesh: Mesh
# ---------- somi_2: Python ----------
"""
Extract vertex indices from a mesh using various patterns.
-
Authors: Anders Holden Deleuran (CITA/KADK), Mario Deuss (LGG/EPFL) 
Github: github.com/AndersDeleuran/ShapeOpGHPython
Updated: 150401
    Args:
        Pattern:
            The vertex indices pattern to extract from the mesh:
                -
                faceVertices = vertex indices for each face.
                vertexNeighbours = neighbour vertex indices for each vertex.
                edgeVertices = vertex indices for each edge.
                verticesAll = vertex indices for each vertex (flat list).
                verticesEach = vertex indices for each vertex (datatree).
                edgeFaceVertices = neighbour face-vertex indices for each edge.
                faceAngleVertices = neighbour vertices for each vertex corner for each face.
                nakedVertices = vertices on the perimeter of the mesh, sorted by closed loops.
        Mesh: The mesh to extract vertex indices from.
    Returns:
        PointIndices: The vertex indices pattern.
"""

import Grasshopper as gh

# Set component name
ghenv.Component.Name = "ShapeOpMeshIndexer"
ghenv.Component.NickName = "SOMI"

def getFaceVertices(mesh):
    
    """ Get datatree with the face vertex indices for each face in a mesh """
    
    faceVertices = gh.DataTree[int]()
    
    for i in range(Mesh.Faces.Count):
        fl = Mesh.Faces.Item[i]
        if fl.IsQuad:
            fIDs = (fl.A,fl.B,fl.C,fl.D)
        else:
            fIDs = (fl.A,fl.B,fl.C)
        faceVertices.AddRange(fIDs,gh.Kernel.Data.GH_Path(i))
        
    return faceVertices

def getVertexNeighbours(mesh):
    
    """ Get datatree with the vertex plus vertex neighbour indices
    for each vertex in a mesh """
    
    vertexNeighbours = gh.DataTree[int]()
    
    for i in range(Mesh.Vertices.Count):
        vnIDs = [i] + list(Mesh.Vertices.GetConnectedVertices(i))
        vertexNeighbours.AddRange(vnIDs,gh.Kernel.Data.GH_Path(i))
        
    return vertexNeighbours

def getEdgeVertices(mesh):
    
    """ Get datatree with the edge vertex indices for each edge in mesh """
    
    # Get edge vertices
    edges = []
    for i in range(Mesh.Vertices.Count):
        neighbours = Mesh.Vertices.GetConnectedVertices(i)
        for n in neighbours:
            if n > i:
                edges.append((i,n))
                
    # Make datatree
    edgeVertices = gh.DataTree[int]()
    for i,e in enumerate(edges):
        edgeVertices.AddRange(e,gh.Kernel.Data.GH_Path(i))
        
    return edgeVertices

def getVerticesEach(mesh):
    
    """ Get datatree with the index of each vertex in a mesh """
    
    verticesEach = gh.DataTree[int]()
    for i in range(Mesh.Vertices.Count):
        verticesEach.AddRange([i],gh.Kernel.Data.GH_Path(i))
        
    return verticesEach

def getVerticesAll(mesh):
    
    """ Get a list with all the vertex indices of a mesh """
    
    verticesAll = range(mesh.Vertices.Count)
    
    return verticesAll

def getEdgeFaceVertices(mesh):
    
    """ Get datatree with the four/six face vertex indices for each mesh edge, 
    which is used to construct the shapeop bending constraint signature """
    
    # Make GH datatree
    edgeFaceVerticesPtIDs = gh.DataTree[int]()
    
    for i in range(mesh.TopologyEdges.Count):
        
        p = gh.Kernel.Data.GH_Path(i)
        
        if len(mesh.TopologyEdges.GetConnectedFaces(i)) == 2:
            
            # Get edge vertex indices
            tVts = mesh.TopologyEdges.GetTopologyVertices(i)
            eVtA = mesh.TopologyVertices.MeshVertexIndices(tVts.I)[0]
            eVtB = mesh.TopologyVertices.MeshVertexIndices(tVts.J)[0]
            eVts = set((eVtA,eVtB))
            
            # Get edge face vertex index
            fA,fB = mesh.TopologyEdges.GetConnectedFaces(i)
            fVtsA = mesh.Faces.GetTopologicalVertices(fA)
            fVtsB = mesh.Faces.GetTopologicalVertices(fB)
            fVtsA = [mesh.TopologyVertices.MeshVertexIndices(i)[0] for i in fVtsA]
            fVtsB = [mesh.TopologyVertices.MeshVertexIndices(i)[0] for i in fVtsB]
            fVts = set(fVtsA + fVtsB)
            
            # Get the face indices which are not part of the edge
            fVts = list(fVts - eVts)
            
            # Make the bending constraint point indices list
            eFVIDs = list(eVts) + fVts
            edgeFaceVerticesPtIDs.AddRange(eFVIDs,p)
            
            
    return edgeFaceVerticesPtIDs

def getFaceAngleVertices(mesh):
    
    """ Get datatree with the face angle vertex indices for each face in a mesh """
    
    faceVertices = gh.DataTree[int]()
    
    n = 0
    for i in range(Mesh.Faces.Count):
        fl = Mesh.Faces.Item[i]
        if fl.IsQuad:
            faceVertices.AddRange((fl.A,fl.B,fl.D),gh.Kernel.Data.GH_Path(n+0))
            faceVertices.AddRange((fl.B,fl.C,fl.A),gh.Kernel.Data.GH_Path(n+1))
            faceVertices.AddRange((fl.C,fl.D,fl.B),gh.Kernel.Data.GH_Path(n+2))
            faceVertices.AddRange((fl.D,fl.A,fl.C),gh.Kernel.Data.GH_Path(n+3))
            n += 4
        else:
            faceVertices.AddRange((fl.A,fl.B,fl.C),gh.Kernel.Data.GH_Path(n+0))
            faceVertices.AddRange((fl.B,fl.C,fl.A),gh.Kernel.Data.GH_Path(n+1))
            faceVertices.AddRange((fl.C,fl.A,fl.B),gh.Kernel.Data.GH_Path(n+2))
            n += 3
            
    return faceVertices

def getNakedVertices(mesh):
    
    """ Get datatree with indices of naked vertices, sorted by closed loops """
    
    # Get naked edges as polylines and naked edge status
    npl = list(mesh.GetNakedEdges())
    nvts = mesh.GetNakedEdgePointStatus()
    
    # Sort the naked vertices by which polyline they belong to
    nakedVertices = gh.DataTree[int]()
    for i,v in enumerate(nvts):
        if v:
            for j,pl in enumerate(npl):
                p = gh.Kernel.Data.GH_Path(j)
                if pl.Contains(mesh.Vertices.Item[i]):
                    nakedVertices.Add(i,p)
                    
    return nakedVertices

if Mesh and Pattern:
    
    if Pattern == "faceVertices":
        PointIndices = getFaceVertices(Mesh)
        
    elif Pattern == "edgeVertices":
        PointIndices = getEdgeVertices(Mesh)
        
    elif Pattern == "vertexNeighbours":
        PointIndices = getVertexNeighbours(Mesh)
        
    elif Pattern == "verticesEach":
        PointIndices = getVerticesEach(Mesh)
        
    elif Pattern == "verticesAll":
        PointIndices = getVerticesAll(Mesh)
        
    elif Pattern == "edgeFaceVertices":
        PointIndices = getEdgeFaceVertices(Mesh)
        
    elif Pattern == "faceAngleVertices":
        PointIndices = getFaceAngleVertices(Mesh)
        
    elif Pattern == "nakedVertices":
        PointIndices = getNakedVertices(Mesh)
else:
    PointIndices = []
# ---------- end somi_2 ----------
socsig_3 = ShapeOpConstraintSignature(ConstraintType=list_5, PointIndices=somi_2, Weights=Slider(200, range=0..200))  # -> ConstraintSigs; inputs PointIndices: tree of Int32, Weights: list, Scalars: tree; same code as socsig_2

list_6 = ValueList({"FaceVertices": "faceVertices", "VertexNeighbours": "vertexNeighbours", "EdgeVertices": "edgeVertices", "VerticesAll": "verticesAll", "VerticesEach": "verticesEach", "EdgeFaceVertices": "edgeFaceVertices", "FaceAngleVertices": "faceAngleVertices", "NakedVertices": "nakedVertices"}, selected="EdgeFaceVertices")
tri_2 = Triangulate(Mesh=mesh)  # -> Mesh, Count
list_7 = ValueList({"EdgeStrain", "TriangleStrain", "TetrahedronStrain", "Area", "Volume", "Bending", "Closeness", "Line", "Plane", "Circle", "Sphere", "Similarity", "Rigid", "Rectangle", "Parallelogram", "Laplacian", "LaplacianDisplacement", "Angle"}, selected="Bending")
somi_3 = ShapeOpMeshIndexer(Pattern=list_6, Mesh=tri_2.Mesh)  # -> PointIndices; inputs Mesh: Mesh; same code as somi
merge_2 = Merge(Data1=Slider(1, range=0..2), Data2=Slider(1, range=0..2))
socsig_4 = ShapeOpConstraintSignature(ConstraintType=list_7, PointIndices=somi_3, Weights=Slider(200, range=0..200), Scalars=merge_2)  # -> ConstraintSigs; inputs PointIndices: tree of Int32, Weights: list, Scalars: tree; same code as socsig_2

list_8 = ValueList({"FaceVertices": "faceVertices", "VertexNeighbours": "vertexNeighbours", "EdgeVertices": "edgeVertices", "VerticesAll": "verticesAll", "VerticesEach": "verticesEach", "EdgeFaceVertices": "edgeFaceVertices", "FaceAngleVertices": "faceAngleVertices", "NakedVertices": "nakedVertices"}, selected="FaceVertices")
list_9 = ValueList({"EdgeStrain", "TriangleStrain", "TetrahedronStrain", "Area", "Volume", "Bending", "Closeness", "Line", "Plane", "Circle", "Sphere", "Similarity", "Rigid", "Rectangle", "Parallelogram", "Laplacian", "LaplacianDisplacement", "Angle"}, selected="LaplacianDisplacement")
somi_4 = ShapeOpMeshIndexer(Pattern=list_8, Mesh=mesh)  # -> PointIndices; inputs Mesh: Mesh; same code as somi_2
socsig_5 = ShapeOpConstraintSignature(ConstraintType=list_9, PointIndices=somi_4, Weights=Slider(200, range=0..200))  # -> ConstraintSigs; inputs PointIndices: tree of Int32, Weights: list, Scalars: tree; same code as socsig_2

list_10 = ValueList({"FaceVertices": "faceVertices", "VertexNeighbours": "vertexNeighbours", "EdgeVertices": "edgeVertices", "VerticesAll": "verticesAll", "VerticesEach": "verticesEach", "EdgeFaceVertices": "edgeFaceVertices", "FaceAngleVertices": "faceAngleVertices", "NakedVertices": "nakedVertices"}, selected="FaceVertices")
list_11 = ValueList({"EdgeStrain", "TriangleStrain", "TetrahedronStrain", "Area", "Volume", "Bending", "Closeness", "Line", "Plane", "Circle", "Sphere", "Similarity", "Rigid", "Rectangle", "Parallelogram", "Laplacian", "LaplacianDisplacement", "Angle"}, selected="Rigid")
somi_5 = ShapeOpMeshIndexer(Pattern=list_10, Mesh=mesh)  # -> PointIndices; inputs Mesh: Mesh; same code as somi_2
quadface = QuadFace(F=Slider(0.43, range=0..2))
socsig_6 = ShapeOpConstraintSignature(ConstraintType=list_11, PointIndices=somi_5, Weights=Slider(200, range=0..200), Scalars=quadface)  # -> ConstraintSigs; inputs PointIndices: tree of Int32, Weights: list, Scalars: tree; same code as socsig_2

list_12 = ValueList({"FaceVertices": "faceVertices", "VertexNeighbours": "vertexNeighbours", "EdgeVertices": "edgeVertices", "VerticesAll": "verticesAll", "VerticesEach": "verticesEach", "EdgeFaceVertices": "edgeFaceVertices", "FaceAngleVertices": "faceAngleVertices", "NakedVertices": "nakedVertices"}, selected="NakedVertices")
list_13 = ValueList({"EdgeStrain", "TriangleStrain", "TetrahedronStrain", "Area", "Volume", "Bending", "Closeness", "Line", "Plane", "Circle", "Sphere", "Similarity", "Rigid", "Rectangle", "Parallelogram", "Laplacian", "LaplacianDisplacement", "Angle"}, selected="Circle")
somi_6 = ShapeOpMeshIndexer(Pattern=list_12, Mesh=mesh)  # -> PointIndices; inputs Mesh: Mesh; same code as somi_2
socsig_7 = ShapeOpConstraintSignature(ConstraintType=list_13, PointIndices=somi_6, Weights=Slider(163.14, range=0..200))  # -> ConstraintSigs; inputs PointIndices: tree of Int32, Weights: list, Scalars: tree; same code as socsig_2

list_14 = ValueList({"FaceVertices": "faceVertices", "VertexNeighbours": "vertexNeighbours", "EdgeVertices": "edgeVertices", "VerticesAll": "verticesAll", "VerticesEach": "verticesEach", "EdgeFaceVertices": "edgeFaceVertices", "FaceAngleVertices": "faceAngleVertices", "NakedVertices": "nakedVertices"}, selected="NakedVertices")
list_15 = ValueList({"EdgeStrain", "TriangleStrain", "TetrahedronStrain", "Area", "Volume", "Bending", "Closeness", "Line", "Plane", "Circle", "Sphere", "Similarity", "Rigid", "Rectangle", "Parallelogram", "Laplacian", "LaplacianDisplacement", "Angle"}, selected="Plane")
somi_7 = ShapeOpMeshIndexer(Pattern=list_14, Mesh=mesh)  # -> PointIndices; inputs Mesh: Mesh; same code as somi_2
socsig_8 = ShapeOpConstraintSignature(ConstraintType=list_15, PointIndices=somi_7, Weights=Slider(300, range=0..500))  # -> ConstraintSigs; inputs PointIndices: tree of Int32, Weights: list, Scalars: tree; same code as socsig_2

# ---- group: UnaryVector
Z = UnitZ(Factor=Slider(5, range=-100..100.001))

# ---- group: Solver Settings (Live)
dynamic = BooleanToggle(False)
pause = BooleanToggle(False)
reset = BooleanToggle(True)
sosl = ShapeOpSettingsLive(
    Iterations=Slider(7, range=1..10),
    Damping=Slider(0.1, range=0..1),
    TimeStep=Slider(0.1, range=0..1),
    Dynamic=dynamic,
    Pause=pause,
    Reset=reset)  # -> Settings; inputs Iterations: Int32, UnaryVector: Vector3d, Dynamic: Boolean, Pause: Boolean, Reset: Boolean
# ---------- sosl: Python ----------
"""
Select the settings for running the ShapeOpConstraintSolver live (i.e
it will iteratively update itself). All of the settings except Reset are optional.
When Reset is set to True to solver will reset and intialize, when it is set to
False the solver will iteratively run the solve step.
-
Authors: Anders Holden Deleuran (CITA/KADK), Mario Deuss (LGG/EPFL) 
Github: github.com/AndersDeleuran/ShapeOpGHPython
Updated: 150330
    Args:
        Iterations: The number of iterations to run each time the component updates (default = 5)
        Mass: The mass of the points (default = 1.00)
        Damping: Velocity damping (default = 1.00)
        TimeStep: The physics simulation time step (default = 0.10)
        UnaryVector: A vector which will apply a force to all points in its direction and magnitude (default = None).
        Dynamic: True to initialize the solver with dynamics (default = True).
        Pause: True to pause, False to unpause (default = False).
        Reset: True to Reset, False to run the solver live.
    Returns:
        Settings: A Python dictionary wrapping the settings.
"""


# Set component name
ghenv.Component.Name = "ShapeOpSettingsLive"
ghenv.Component.NickName = "SOSL"

# Check/set inputs
if Iterations is None:
    Iterations = 5
if Mass is None:
    Mass = 1.00
if Damping is None:
    Damping = 1.0
if TimeStep is None:
    TimeStep = 0.1
if Dynamic is None:
    Dynamic = True
if Reset is None:
    Reset = True
if Pause is None:
    Pause = False

# Wrap all settings in a dict
Settings = [{"mode":"live","iterations":Iterations,"mass":Mass,"damping":Damping,"timeStep":TimeStep,"dynamic":Dynamic,"reset":Reset,"pause":Pause,"unaryVector":UnaryVector},]
# ---------- end sosl ----------

# ---- group: Solver Settings (Static)
soss = ShapeOpSettingsStatic(Iterations=Slider(60, range=0..200))  # -> Settings; inputs Iterations: Int32
# ---------- soss: Python ----------
"""
Select the settings for running the ShapeOpConstraintSolver statically (i.e
it will run all the iterations in one go). In this case the solver is always
initalized without dynamics.
-
Authors: Anders Holden Deleuran (CITA/KADK), Mario Deuss (LGG/EPFL) 
Github: github.com/AndersDeleuran/ShapeOpGHPython
Updated: 150330
    Args:
        Iterations: The amount of iterations to run.
    Returns:
        Settings: A Python dictionary wrapping the settings.
"""


# Set component name
ghenv.Component.Name = "ShapeOpSettingsStatic"
ghenv.Component.NickName = "SOSS"


# Check/set inputs
if Iterations is None:
    Iterations = 50

# Wrap all settings in dict and output to GH
Settings = [{"mode":"static","iterations":Iterations},]
# ---------- end soss ----------

# ----
constraintsigs = Data(flatten([socsig, socsig_6, socsig_4]))

# ---- group: Run ShapeOp Solver
sosolver = ShapeOpConstraintSolver(ConstraintSigs=constraintsigs, Points=demesh.Vertices, Settings=sosl)  # -> Iterations, ConstraintCount, Points; inputs ConstraintSigs: list, Points: list of Point3d
# ---------- sosolver: Python ----------
"""
Make a ShapeOp solver and solve a whole bunch of constraints!
-
Authors: Anders Holden Deleuran (CITA/KADK), Mario Deuss (LGG/EPFL) 
Github: github.com/AndersDeleuran/ShapeOpGHPython
Updated: 150402
    Args:
        ConstraintSigs: Signatures used for adding and editing constaints.
        Points: Points which the solver will operate on. ConstraintSigs should be constructed using the indices of this list.
        Settings: A list of settings which will be used to set up and run the solver..
    Returns:
        Iterations: The number of iterations the solver has run.
        ConstraintCount: The total number of contraints which are being solved.
        Points: The constrained points after solving.
"""

import Rhino as rc
import ctypes as ct
import Grasshopper as gh
from scriptcontext import sticky as st
so = ct.cdll.LoadLibrary("ShapeOp.0.1.0.dll")

# Set component name
ghenv.Component.Name = "ShapeOpConstraintSolver"
ghenv.Component.NickName = "SOSolver"

def makeSoSolver(points):
    
    """ Make ShapeOp solver and returns its ID and points coordinates ID """
    
    solver = so.shapeop_create()
    
    # Make ctypes double array containing points coordinates
    ptCoords = (ct.c_double * (len(points)*3))()
    for i in range(len(points)):
        b = 3*i
        ptCoords[b] = float(points[i].X)
        ptCoords[b+1] = float(points[i].Y)
        ptCoords[b+2] = float(points[i].Z)
        
   # Add points coordinates to solver
    so.shapeop_setPoints(solver,ct.byref(ptCoords),len(points))
    
    return solver,ptCoords

def addSoConstraint(solver,constraintType,pointIndices,weight):
    
    """ Add a constraint: The solver is ID of shapeop solver, constraintType
    is name of constraint type to apply, pointIndices is list of points indices
    to operate on, weight is a float """
    
    t = ct.c_char_p(constraintType)
    ptIds = (ct.c_int * len(pointIndices))()
    for i,v in enumerate(pointIndices):
        ptIds[i] = v
        
    id = so.shapeop_addConstraint(solver,t,ct.byref(ptIds),len(pointIndices),weight)
    if id < 0 :
        raise LookupError("addSoConstraint failed adding a constraint of type "+constraintType)
    
    return id

def editSoConstraint(solver,constraintType,constraintId,scalars):
    
    """ Edit a constraint: solver is ID of shapeop solver, constraintType
    is name of constraint type to edit, constraintId is ID if the constraint.
    scalars is list of floats """
    
    t = ct.c_char_p(constraintType)
    scalarsC = (ct.c_double * len(scalars))()
    for i,s in enumerate(scalars):
        scalarsC[i] = s
        
    errCode = so.shapeop_editConstraint(solver,t,constraintId,ct.byref(scalarsC),len(scalars))
    if errCode != 0 :
        raise LookupError("editSoConstraint failed editing constraint. Check that SOGSig scalars are correctly defined.")

def addUnaryForce(solver,vector):
    
    """ Add a unary force to all points in the solver, only works dynamically """
    
    fv = (ct.c_double * 3)()
    fv[0] = float(vector.X)
    fv[1] = float(vector.Y)
    fv[2] = float(vector.Z)
    
    so.shapeop_addGravityForce(solver,fv)

def runSoSolverStatic(constraintSigs,points,settings):
    
    """ Run the ShapeOp solver statically and return the points """
    
    # Make ShapeOp solver
    solver,ptCoords = makeSoSolver(points)
    
    # Add constraints to the solver from the constraint signatures dictionary
    csCount = 0
    for csd in constraintSigs:
        for i in range(len(csd["pointIndices"])):
            csid = addSoConstraint(solver,csd["type"],csd["pointIndices"][i],csd["weights"][i])
            csCount += 1
            if csd["scalars"]:
                editSoConstraint(solver,csd["type"],csid,csd["scalars"][i])
                
    # Initialize and solve
    err_code = so.shapeop_init(solver)
    if err_code != 0 :
        raise LookupError("ShapeOp initialization failed.")
    err_code = so.shapeop_solve(solver,settings["iterations"])
    if err_code != 0 :
        raise LookupError("ShapeOp solve failed.")
    
    # Update and return the points list
    so.shapeop_getPoints(solver,ct.byref(ptCoords),len(points))
    for i in range(len(points)):
        b = i*3
        points[i] = rc.Geometry.Point3d(ptCoords[b],ptCoords[b+1],ptCoords[b+2])
        
    # Delete solver
    so.shapeop_delete(solver)
    
    return points,settings["iterations"],csCount

def runSoSolverLive(ghenv,constraintSigs,points,settings):
    
    """ Run the ShapeOp solver cyclically (live) and return the points """
    
    # Get GH component guid and make unique variable names for sticky keys
    guid = str(ghenv.Component.InstanceGuid) + str(ghdoc.Path)
    solver = "solver_" + guid
    ptCoords = "vCoords_" + guid
    count = "count_" + guid
    editableCS = "editableCS" + guid
    csCount = "csCount_" + guid
    
    if settings["reset"]:
        
        # Delete old solver
        if solver in st:
            so.shapeop_delete(st[solver])
            
        # Make ShapeOp solver
        st[solver],st[ptCoords] = makeSoSolver(points)
        
        # Add constraints to the solver from the constraint signatures dictionary
        st[editableCS] = []
        st[csCount] = 0
        for i,csd in enumerate(constraintSigs):
            for j in range(len(csd["pointIndices"])):
                csid = addSoConstraint(st[solver],csd["type"],csd["pointIndices"][j],csd["weights"][j])
                st[csCount] += 1
                if csd["scalars"]:
                    editSoConstraint(st[solver],csd["type"],csid,csd["scalars"][j])
                    st[editableCS].append((i,j,csid))
                    
        # Add unary force
        if settings['unaryVector']:
            addUnaryForce(st[solver],settings['unaryVector'])
        
        # Initialize solver
        err_code = 0
        if settings["dynamic"]:
            err_code = so.shapeop_initDynamic(st[solver],settings["mass"],settings["damping"],settings["timeStep"])
        else:
            err_code = so.shapeop_init(st[solver])
        if err_code != 0 :
            raise LookupError("ShapeOp init failed. Check that each point is constrained.")
        
        # Reset count
        st[count] = 0
        
        # Set component message
        ghenv.Component.Message = None
        
    else:
        
        # Update editable constraints
        for l in st[editableCS]:
            csdIndex,scalarsIndex,csid = l[0],l[1],l[2]
            scalars = constraintSigs[csdIndex]["scalars"]
            t = constraintSigs[csdIndex]["type"]
            editSoConstraint(st[solver],t,csid,scalars[scalarsIndex])
            
        # Solve and update the Grasshopper component (ie. update cyclically)
        err_code = so.shapeop_solve(st[solver],settings["iterations"])
        if err_code != 0 :
            raise LookupError("ShapeOp solve failed.")
        ghComponentTimer(ghenv,settings["pause"],10)
        
        # Increment count
        st[count] += 1*settings["iterations"]
        
        # Set component message
        message = "Solver is Running Live"
        if settings["pause"]:
            message = "Solver is Paused"
        ghenv.Component.Message = message
        
    # Update and return the points list
    so.shapeop_getPoints(st[solver],ct.byref(st[ptCoords]),len(points))
    for i in range(len(points)):
        b = i*3
        points[i] = rc.Geometry.Point3d(st[ptCoords][b],st[ptCoords][b+1],st[ptCoords][b+2])
        
    return points,st[count],st[csCount]

def ghComponentTimer(ghenv,pause,interval):
    
    """ Update the component at the interval like using a GH timer """
    
    # Ensure interval is larger than zero
    if interval <= 0:
        interval = 1
        
    # Get the Grasshopper document and component that owns this script
    ghComp = ghenv.Component
    ghDoc = ghComp.OnPingDocument()
    
    # Define the callback function
    def callBack(ghDoc):
        ghComp.ExpireSolution(False)
        
    # Update the solution
    if not pause:
        ghDoc.ScheduleSolution(interval,gh.Kernel.GH_Document.GH_ScheduleDelegate(callBack))

# Check GH input parameters
if ConstraintSigs and Points and Settings:
    
    # Run solver statically (i.e. only one GH iteration)
    if Settings["mode"] == "static":
        Points,Iterations,ConstraintCount = runSoSolverStatic(ConstraintSigs,Points,Settings)
        
    # Run solver live (i.e. the solver component will cyclically update)
    elif Settings["mode"] == "live":
        Points,Iterations,ConstraintCount = runSoSolverLive(ghenv,ConstraintSigs,Points,Settings)
# ---------- end sosolver ----------
panel = Panel([sosolver.Iterations, sosolver.ConstraintCount])

# ---- group: Update Mesh Vertex Positions
conmesh = ConstructMesh(Vertices=sosolver.Points, Faces=demesh.Faces)

# ---- group: Output Mesh
mesh_3 = Mesh(conmesh)

# ---- group: Analyse Mesh Area
mesh_4 = Mesh()
area = MeshArea(Mesh=mesh_4)  # -> Area, Centroid

# ---- group: Analyse Mesh Face Circles
mfc = MeshFaceCircles()

# ---- group: Analyse Mesh Edge Lengths
mel = MeshEdgeLengths()  # -> edgelengths, averageedgelength

# ---- group: Render Mesh
R = Render(geo=mesh_3)

# ==== cluster MeshFaceCircles: Draw circles through mesh face vertices
mesh = ClusterInput()
mesh_2 = Mesh(mesh)

# ---- group: Get Face Vertices
demesh = DeconstructMesh(Mesh=mesh_2)  # -> Vertices, Faces, Colours, Normals
deface = DeconstructFace(Face=graft(demesh.Faces))  # -> CornerA, CornerB, CornerC, CornerD
merge = Merge(Data1=deface.CornerA, Data2=deface.CornerB, Data3=deface.CornerC, Data4=deface.CornerD)  # -> simplify(Result)
item = ListItem(List=demesh.Vertices, Index=merge, Wrap=True)

# ---- group: Make Circles
item_2 = ListItem(List=item, Index=0, Wrap=True)  # -> Item, Item1, Item2
circle = Circle3Pt(PointA=item_2.Item, PointB=item_2.Item1, PointC=item_2.Item2)  # -> graft(Circle), Plane, Radius

# ---- group: Get total distance from vertices to circle
crv_cp = CurveClosestPoint(Point=item, Curve=circle.Circle)  # -> Point, Parameter, Distance
ma = MassAddition(Input=crv_cp.Distance)  # -> flatten(Result), PartialResults

# ---- group: Map Gradient
td = Number(ma.Result)
dom = ConstructDomain(DomainStart=Slider(0.7, range=0..1), DomainEnd=Slider(0, range=0..1))
remap = RemapNumbers(Value=td, Source=Domain(0, 1), Target=dom)  # -> Mapped, Clipped
hsl = ColourHSL(Alpha=1, Hue=remap.Mapped, Saturation=1, Luminance=0.5)

# ----
circle_2 = Circle(flatten(circle.Circle))
circle_3 = ClusterOutput(circle_2)
preview = CustomPreview(Geometry=circle_2, Shader=hsl)

# ==== cluster MeshEdgeLengths
mesh = ClusterInput()
mesh_2 = Mesh(mesh)
medges = MeshEdges(Mesh=mesh_2)  # -> NakedEdges, InteriorEdges, NonManifoldEdges
len = Length(Curve=[medges.NakedEdges, medges.InteriorEdges, medges.NonManifoldEdges])
avr = Average(Input=len)
edgelengths = ClusterOutput(len)
averageedgelength = ClusterOutput(avr)

# ==== cluster GenerateComplexMesh: GenerateComplexMesh
xy = Slider(38, range=0..100)

# ---- group: Generate Random Points
pt = ConstructPoint(XCoordinate=xy, YCoordinate=xy, ZCoordinate=0)
rec_2pt = Rectangle2Pt(Plane=PlaneXY(0, 0, 0), PointA=Point(0, 0, 0), PointB=pt, Radius=0)  # -> Rectangle, Length
pop2d = Populate2D(Region=rec_2pt.Rectangle, Count=Slider(10, range=0..40), Seed=Slider(7, range=0..40))

# ---- group: Triangulate Points and Get Dual
del = DelaunayMesh(Points=pop2d, Plane=PlaneXY(0, 0, 0))
wbdual = WeaverbirdsDualGraph(MeshCurves=del, DualMode=0)

# ---- group: Offset Duasl as a Mesh
python = PythonScript(
    Cells=wbdual,
    Distance=Slider(2.875, range=-2..4),
    InsideAreaM=Slider(273.269, range=-2..1000),
    OutsideAreaM=Slider(1560.926, range=-2..3000))  # -> Mesh; inputs Cells: list of Polyline
# ---------- python: Python ----------
import Rhino as rc
import math
import copy

a = []

def averagePoints(points):
    
    x = sum([pt.X for pt in points])/len(points)
    y = sum([pt.Y for pt in points])/len(points)
    z = sum([pt.Z for pt in points])/len(points)
    
    return rc.Geometry.Point3d(x,y,z)

def meshCellPolyline(cell,distance,areaMultiplier):
    
    # Get cell area
    area = rc.Geometry.AreaMassProperties.Compute(cell.ToNurbsCurve()).Area
    
    # Copy cell and move its points to center
    cellA = list(cell)    
    cellB = []
    midPoint = averagePoints(cellA)
    for pt in cellA:
        v = midPoint - pt
        v.Unitize()
        v = v*distance*(area/areaMultiplier)
        pt = pt + v
        cellB.append(pt + v)
        
    # Make mesh faces
    faces = []
    for i in range(len(cellA)-1):
        
        # Make mesh and add vertices
        f = rc.Geometry.Mesh()
        f.Vertices.Add(cellA[i])
        f.Vertices.Add(cellA[i+1])
        f.Vertices.Add(cellB[i+1])
        f.Vertices.Add(cellB[i])
        f.Faces.AddFace(0,1,2,3)
        faces.append(f)
        
    # Join face mesh
    mesh = rc.Geometry.Mesh()
    for m in faces:
        mesh.Append(m)
    mesh.Weld(math.radians(180))
    
    return mesh

def main(cells,distance,insideAreaM,outsideAreadM):
    
    # Make meshes for all cells and join/weld them
    cMesh = rc.Geometry.Mesh()
    for c in Cells:
        mc = meshCellPolyline(c,distance,insideAreaM)
        cMesh.Append(mc)
    
    # Get outer naked loop
    ne = cMesh.GetNakedEdges()
    nel = [pl.Length for pl in ne]
    ol = ne[nel.index(max(nel))]
    
    # Make outer loop cell mesh
    olm = meshCellPolyline(ol,-distance,outsideAreadM)
    cMesh.Append(olm)
    
    # Weld, normals etc
    cMesh.Weld(math.radians(180))
    cMesh.UnifyNormals()
    cMesh.Normals.ComputeNormals()
    cMesh.FaceNormals.ComputeFaceNormals()
    
    return cMesh

#Meshes = [meshCellPolyline(crv,Distance) for crv in Cells]
Mesh = main(Cells,Distance,InsideAreaM,OutsideAreaM)
# ---------- end python ----------

# ---- group: Join and Weld Meshes
mjoin = MeshJoin(Meshes=python)
weld = WeldMesh(Mesh=mjoin, Angle=3.141592654)

# ----
geo = Geometry()

# ---- group: Randomæy Translate Naked Vertex Loops
domain = Slider(6.4, range=-10..10)
mesh = Mesh(weld)
python_2 = PythonScript(Mesh=mesh)  # -> NakedVertices, Loops; inputs Mesh: Mesh
# ---------- python_2: Python ----------
import Grasshopper as gh


def getNakedVertices(mesh):
    
    """ Get datatree with indices of naked vertices, sorted by closed loops """
    
    # Get naked edges as polylines and naked edge status
    npl = list(mesh.GetNakedEdges())
    nvts = mesh.GetNakedEdgePointStatus()
    
    # Sort the naked vertices by which polyline they belong to
    nakedVertices = gh.DataTree[int]()
    for i,v in enumerate(nvts):
        if v:
            for j,pl in enumerate(npl):
                p = gh.Kernel.Data.GH_Path(j)
                if pl.Contains(mesh.Vertices.Item[i]):
                    nakedVertices.Add(i,p)
                    
    return nakedVertices,len(npl)

NakedVertices,Loops = getNakedVertices(Mesh)
# ---------- end python_2 ----------
demesh = DeconstructMesh(Mesh=mesh)  # -> Vertices, Faces, Colours, Normals
dom = ConstructDomain(DomainStart=expr("-x", domain), DomainEnd=domain)
random = Random(Range=dom, Number=python_2.Loops, Seed=Slider(19, range=0..100))
item = ListItem(List=demesh.Vertices, Index=python_2.NakedVertices, Wrap=True)
Z = UnitZ(Factor=random)
move = Move(Geometry=item, Motion=graft(Z))  # -> Geometry, Transform
replace = ReplaceItems(List=demesh.Vertices, Item=flatten(move.Geometry), Indices=flatten(python_2.NakedVertices), Wrap=False)
conmesh = ConstructMesh(Vertices=replace, Faces=demesh.Faces)

# ---- group: Subdivide Mesh
wbcatmullclark = WeaverbirdsCatmullClarkSubdivision(MeshCurves=conmesh, Level=Slider(2, range=0..3), SmoothNakedEdges=Slider(1, range=0..2))

# ---- group: Compute Normals
python_3 = PythonScript(Mesh=wbcatmullclark)  # -> Mesh; inputs Mesh: Mesh
# ---------- python_3: Python ----------
Mesh.FaceNormals.ComputeFaceNormals()
Mesh.Normals.ComputeNormals()
# ---------- end python_3 ----------

# ----
complexmesh = Mesh(python_3)
complexmesh_2 = ClusterOutput(complexmesh)

# ==== cluster Render
geo = ClusterInput()
geo_2 = Geometry(geo)
material = CreateMaterial(
    Diffuse=ColourSwatch(SwatchColor=RGB(38, 38, 38)),
    Specular=ColourSwatch(SwatchColor=RGB(181, 181, 181)),
    Emission=ColourSwatch(SwatchColor=RGB(189, 189, 189)),
    Transparency=Slider(0, range=0..1),
    Shine=Slider(86, range=0..100))
preview = CustomPreview(Geometry=geo_2, Shader=material)

# ==== cluster QuadFace
meshface = Mesh(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)
demesh = DeconstructMesh(Mesh=meshface)  # -> Vertices, Faces, Colours, Normals
avr = Average(Input=demesh.Vertices)
F = ClusterInput()
scale = Scale(Geometry=meshface, Center=avr, Factor=F)  # -> Geometry, Transform
demesh_2 = DeconstructMesh(Mesh=scale.Geometry)  # -> Vertices, Faces, Colours, Normals
V = ClusterOutput(demesh_2.Vertices)

# ==== cluster Cluster
pt = ClusterInput()
pt_2 = Point(pt)
avr = Average(Input=pt_2)
cp = ClosestPoint(Point=avr, Cloud=pt_2)  # -> ClosestPoint, CPIndex, Distance
P = ClusterOutput(cp.ClosestPoint)
